# Grasshopper definition 200107_rosbridge_client.gh (Grasshopper 1.0.7)

server_address_port = Panel("192.168.56.100,9090")

# ---- group: CLIENT
bool = Boolean(Button())
bool_2 = Boolean(Button())
client = PythonScript(start=bool, stop=bool_2, srv_addr=server_address_port)  # -> out, instance
# ---------- client: Python ----------
#author: ondrej.kyjanek@gmail.com

import threading
import socket
import select
import time
import json
import roslibpy

from Grasshopper.Kernel import GH_RuntimeMessageLevel

class RoslibThread(threading.Thread):
    def __init__(self,address,*args,**kwargs):
        self.stop_event = threading.Event()
        self.client = client = roslibpy.Ros(
            host=address[0], 
            port=address[1]
            )
        super(RoslibThread,self).__init__(
            name='RoslibThread-{}'.format(ghenv.Component.InstanceGuid),
            *args,
            **kwargs)
        self.daemon = True
    
    def run(self):
        self.client.run_forever()
    
    def stop(self):
        self.stop_event.set()
        self.client.terminate()
        

def parse_addr(addr_string):
    addr_tuple = addr_string.split(",")
    addr_tuple = (addr_tuple[0],int(addr_tuple[1]))
    return addr_tuple

def print_err(err):
    ghenv.Component.Message = ""
    ghenv.Component.AddRuntimeMessage(
        GH_RuntimeMessageLevel.Error,
        err.message)
    print(err)

def kill_thread():
    for t in threading.enumerate():
        if t.name == 'RoslibThread-{}'.format(ghenv.Component.InstanceGuid):
            t.stop()
            t.join(3)

if start:
    if 'roslib_thread' in globals(): 
        roslib_thread.stop()
    kill_thread()
    try:
        roslib_thread = RoslibThread(parse_addr(srv_addr))
        roslib_thread.start()
        time.sleep(0.1)
    except Exception as e:
        print_err(e)

if stop:
    if 'roslib_thread' in globals(): 
        roslib_thread.stop()
    kill_thread()

if 'roslib_thread' in globals(): 
    instance = roslib_thread.client
    ghenv.Component.Message = "Connected" if roslib_thread.client.is_connected else "Disconnected"
    print("Client is alive: {}".format(roslib_thread.client.is_connected))
else:
    ghenv.Component.Message = "Not initialized"
    print('Component is not initialized.')
# ---------- end client ----------
connection_info = Panel(client.out)

# ----
panel = Panel("/client_count,std_msgs/Int32")
python = GhPythonScript(list=Button(), kill=Button())  # -> out; inputs kill: Boolean
# ---------- python: Python ----------
__author__ = "Ondrej Kyjanek"
__version__ = "2019.12.26"

import rhinoscriptsyntax as rs
import threading

if list:
    thread_names = []
    for t in threading.enumerate():
        thread_names.append(t.name)

if kill:
    thread_names = []
    for t in threading.enumerate():
        thread_names.append(t.name)
        if t.name.split('-')[0] == 'RoslibThread':
            t.stop()
            t.join(3)

if 'thread_names' in globals():
    for tn in thread_names:
        print(tn)
# ---------- end python ----------
timer = Timer(TimerInterval=500, Target=python_2)  # disabled
panel_2 = Panel(python)
python_2 = GhPythonScript(subscribe=Toggle(True), instance=client.instance, topic_args="/test_pose,geometry_msgs/PoseStamped")  # -> out, msg_str; inputs subscribe: Boolean, topic_args: list
# ---------- python_2: Python ----------
__author__ = "Ondrej Kyjanek"
__version__ = "2019.12.27"

import json
import roslibpy
from collections import deque
from Grasshopper.Kernel import GH_RuntimeMessageLevel

QUEUE_SIZE = 1
IS_STACK = False

def callback(message):
    queue.append(message)

topic_args = [[y.strip() for y in x.split(',')] for x in  topic_args]

if 'topic' not in globals(): 
    topic = []
    msg_json = None
    queue = None
    is_subscribed = False

if subscribe==None or subscribe==False:
    for t in topic:
        t.unsubscribe()
    ghenv.Component.Message = "Unsubscribed"
    is_subscribed = False
elif subscribe and instance!=None and is_subscribed == False:
    global queue
    queue = deque(maxlen=QUEUE_SIZE)
    msg_json = None
    topic = []
    
    for ta in topic_args:
        _t = roslibpy.Topic(instance, ta[0], ta[1])
        _t.subscribe(callback)
        topic.append(_t)
    ghenv.Component.Message = "Subscribed"
    is_subscribed = True
elif instance==None:
    ghenv.Component.Message = ""
    ghenv.Component.AddRuntimeMessage(
        GH_RuntimeMessageLevel.Warning,
        "Client is not connected")

try:
    print(queue)
    for i,t in enumerate(topic):
        print('Topic {} is subscribed: {}'.format(
            t.name,
            t.is_subscribed))
    if IS_STACK:
        msg_json = queue.popright()
    else:
        msg_json = queue.popleft()
except Exception as e:
    print(e)
msg_str = json.dumps(msg_json)
# ---------- end python_2 ----------
python_3 = GhPythonScript(
    send=Button(),
    instance=client.instance,
    service_args="/rosapi/subscribers,rosapi/Subscribers",
    req_str="{\"topic\": \"/client_count\"}")  # -> out, resp_str; inputs send: Boolean
# ---------- python_3: Python ----------
__author__ = "Ondrej Kyjanek"
__version__ = "2019.12.27"

import json
import roslibpy
from collections import deque
from Grasshopper.Kernel import GH_RuntimeMessageLevel

service_args = [y.strip() for y in service_args.split(',')]

if send and instance != None and instance.is_connected:
    ghenv.Component.Message = ""
    error = None
    response = None
    service = roslibpy.Service(instance, service_args[0],service_args[1])
    request = roslibpy.ServiceRequest(json.loads(req_str))
    try:
        ghenv.Component.Message = "Response send"
        response = service.call(request,timeout=5)
    except Exception as e:
        error = e

if "error" in globals():
    print(error)
    if response:
        resp_str = response
        ghenv.Component.Message = "Response received"
    else:
        ghenv.Component.Message = ""
# ---------- end python_3 ----------
python_4 = GhPythonScript(advertise=Toggle(False), instance=client.instance, topic_args="/test_echo,std_msgs/String", msg_str=python_2.msg_str)  # -> out; inputs advertise: Boolean, topic_args: list
# ---------- python_4: Python ----------
__author__ = "Ondrej Kyjanek"
__version__ = "2019.12.27"

import json
import roslibpy
from collections import deque
from Grasshopper.Kernel import GH_RuntimeMessageLevel

topic_args = [[y.strip() for y in x.split(',')] for x in  topic_args]

if 'topic' not in globals(): 
    topic = []
    msg_json = None
    queue = None
    is_advertised = False

if advertise==None or advertise==False:
    for t in topic:
        t.unadvertise()
    ghenv.Component.Message = "Unadvertised"
    is_advertised = False
elif advertise and instance!=None and is_advertised == False:
    msg_json = None
    topic = []
    
    for ta in topic_args:
        _t = roslibpy.Topic(instance, ta[0], ta[1])
        _t.advertise(callback)
        topic.append(_t)
    ghenv.Component.Message = "Advertised"
    is_advertised = True
elif instance==None:
    ghenv.Component.Message = ""
    ghenv.Component.AddRuntimeMessage(
        GH_RuntimeMessageLevel.Warning,
        "Client is not connected")

if instance != None and instance.is_connected:
    for i,t in enumerate(topic):
        print('Topic {} is advertised: {}'.format(
            t.name,
            t.is_advertised))
        if t.is_advertised:
            try:
                t.publish(roslibpy.Message(json.loads(msg_str)))
            except Exception as e:
                print(e)
# ---------- end python_4 ----------
python_5 = GhPythonScript(msg_str=python_2.msg_str)  # -> key, value
# ---------- python_5: Python ----------
__author__ = "Ondrej Kyjanek"
__version__ = "2019.12.28"

import json
from Grasshopper.Kernel import GH_Param
from Grasshopper.Kernel.Parameters import Param_GenericObject
from System import Object, Array
from Grasshopper import DataTree
from Grasshopper.Kernel.Data import GH_Path

value = DataTree[Object]()
key = DataTree[str]()

def expand_msg(_msg,_path,_key=''):
    if type(_msg) == dict:
        for i,kv in enumerate(_msg.items()):
            path_copy = _path[:]
            path_copy.append(i)
            expand_msg(kv[1],path_copy,kv[0])
    elif type(_msg) == list:
        for x in _msg:
            _path[len(_path)-1]+=1
            expand_msg(x,_path,_key)
    else:
        
        value.Add(_msg,GH_Path(Array[int](_path)))
        key.Add(_key,GH_Path(Array[int](_path)))

msg = json.loads(msg_str)
expand_msg(msg,[0],'')
# ---------- end python_5 ----------
panel_3 = Panel(python_2.out)
panel_4 = Panel(python_5.value)
panel_5 = Panel(python_3.resp_str)
